# Grasshopper definition CAR_panels.gh (Grasshopper 1.0.7)
# plug-ins: LunchBox, Weaverbird, MeshEdit Components

# ---- group: RH_IN: VDivision
number_slider = Slider(52, range=0..60)

# ---- group: RH_IN:UDivision
number_slider_2 = Slider(27, range=0..40)

# ---- group: RH_IN: RangeStart
number_slider_3 = Slider(41, range=0..100)

# ---- group: RH_IN: RangeEnd
number_slider_4 = Slider(98, range=0..100)

# ----
vdivision = GetInteger(number_slider, AtLeast=1, AtMost=1, Maximum=2147483647, Minimum=-2147483648)
rangeend = GetInteger(number_slider_4, AtLeast=1, AtMost=1, Maximum=2147483647, Minimum=-2147483648)
rangestart = GetInteger(number_slider_3, AtLeast=1, AtMost=1, Maximum=2147483647, Minimum=-2147483648)
udivision = GetInteger(number_slider_2, AtLeast=1, AtMost=1, Maximum=2147483647, Minimum=-2147483648)
subd = SubD(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)
surface = Surface(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)
point = Point(Point(-0.07530501026, 0.0033469911, 2.037235508))
triangle_panels_b = TrianglePanelsB(Surface=surface, UDivisions=udivision, VDivisions=vdivision)
simple_mesh = SimpleMesh(Brep=triangle_panels_b)
mesh_area = MeshArea(Mesh=simple_mesh)  # -> Area, Centroid
pull_point = PullPoint(Point=mesh_area.Centroid, Geometry=point, ClosestOnly=True)  # -> ClosestPoint, Distance
division = Division(A=rangestart, B="100")
division_2 = Division(A=rangeend, B="100")
bounds = Bounds(Numbers=flatten(pull_point.Distance))
construct_domain = ConstructDomain(DomainStart=division, DomainEnd=division_2)
number_slider_5 = Slider(0.001, range=0..0.01)
remap_numbers = RemapNumbers(Value=pull_point.Distance, Source=bounds, Target=construct_domain)  # -> Mapped, Clipped
scale = Scale(Geometry=triangle_panels_b, Center=mesh_area.Centroid, Factor=remap_numbers.Mapped)  # -> Geometry, Transform
mesh_brep = MeshBrep(
    Brep=surface,
    Settings={GridMaxCount=0, GridMinCount=16, JaggedSeams=False, MaxEdgeLength=0, MinEdgeLength=0.0001, MinTolerance=0, Refine=True, RefineAngle=0, RelativeTolerance=0.65, SimplePlanes=True, Tolerance=0})
negative = Negative(Value=number_slider_5)
multiplication = Multiplication(A=number_slider_5, B=Slider(20, range=0..20))
weaverbird_s_mesh_thicken = WeaverbirdsMeshThicken(MeshCurves=mesh_brep, Distance=negative, OffsetType=0)
unit_z = UnitZ(Factor=multiplication)
mesh_from_subd = MeshFromSubD(SubD=subd, Density=2)
extrude = Extrude(Base=scale.Geometry, Direction=unit_z)
unit_z_2 = UnitZ(Factor="0.02")
mesh_colours = MeshColours(Mesh=weaverbird_s_mesh_thicken, Colours=ColourSwatch(SwatchColor=RGBA(0, 143, 204, 76)))
mesh_colours_2 = MeshColours(Mesh=mesh_from_subd, Colours=ColourSwatch(SwatchColor=RGB(166, 166, 166)))
move = Move(Geometry=extrude, Motion=unit_z_2)  # -> Geometry, Transform
mesh_colours_3 = MeshColours(Mesh=move.Geometry, Colours=ColourSwatch(SwatchColor=RGB(0, 0, 0)))

# ---- group: RH_OUT: Mesh2
geometry = Geometry(mesh_colours)

# ---- group: RH_OUT:Mesh1
geometry_2 = Geometry(mesh_colours_2)

# ---- group: RH_OUT: Mesh3
mesh = Mesh(mesh_colours_3)
